# Grasshopper definition blueprint_composer.ghx (Grasshopper 1.0.8)

enable_auto_reload = Python3Script()  # -> ok
# ---------- enable_auto_reload: Python ----------
from compas_rhino.devtools import DevTools
DevTools.enable_reloader()
# ---------- end enable_auto_reload ----------
script = Script()  # -> out, a
# ---------- script: Python ----------
# env: /Users/gcasas/eth/projects/gramaziokohler/antikythera/src

from compas_rhino.devtools import DevTools
DevTools.ensure_path()

from blueprint_composer import get_agent_classes
from blueprint_composer import BlueprintComposer
from blueprint_composer import TaskDefinition
from blueprint_composer import get_full_tool_name
# ---------- end script ----------
start = Script()  # -> task
# ---------- start: Python ----------
from compas_rhino.devtools import DevTools
DevTools.ensure_path()

from blueprint_composer import get_agent_classes
from blueprint_composer import get_full_tool_name
from blueprint_composer import GrasshopperNodeCreator

# from compas_ghpython import create_id

import Grasshopper
from scriptcontext import sticky as st
from System.Windows.Forms import ToolStripMenuItem
from System.Windows.Forms import ToolStripSeparator


class AgentNodeComponent(Grasshopper.Kernel.GH_ScriptInstance):
    def __init__(self):
        super(AgentNodeComponent, self).__init__()
        self.classes = {}
        for cls in get_agent_classes():
            self.classes[cls.agent_type] = cls

        self.agent_class = None
        self.tool_name = None

    def RunScript(self, depends_on):
        ghc = GrasshopperNodeCreator()
        return ghc.convert_node_to_task_definition(ghenv, self.agent_class, self.tool_name)

    def AppendAdditionalMenuItems(self, menu):
        for i, (agent_key, agent_class) in enumerate(self.classes.items()):
            if i > 0:
                menu.Items.Add(ToolStripSeparator())

            for tool in agent_class.tools:
                tool_item = menu.Items.Add(get_full_tool_name(agent_class, tool), None, self.on_tool_click)
                tool_item.Checked = self.tool_name == tool
 
        menu.Items.Add(ToolStripSeparator())

    def on_tool_click(self, sender, event_info):
        agent, tool = str(sender).split(".", 1)
        self.agent_class = self.classes.get(agent, "Failed to locate the agent class!")
        self.tool_name = tool
        
        # rename_cpython_gh_output(self.processing_type.__name__, 0, ghenv)
        # manage_cpython_dynamic_params(self.arg_names(), ghenv, rename_count=0, permanent_param_count=1)

        ghenv.Component.Message = str(sender)
        ghenv.Component.ExpireSolution(True)
# ---------- end start ----------
B = Script(depends_on=start)  # -> out, task, bbbb; inputs depends_on: list
# ---------- B: Python ----------
from compas_rhino.devtools import DevTools
DevTools.ensure_path()

from blueprint_composer import get_agent_classes
from blueprint_composer import get_full_tool_name
from blueprint_composer import GrasshopperNodeCreator

# from compas_ghpython import create_id

import Grasshopper
import System

from scriptcontext import sticky as st
from System.Windows.Forms import ToolStripMenuItem
from System.Windows.Forms import ToolStripSeparator


class AgentNodeComponent(Grasshopper.Kernel.GH_ScriptInstance):
    def __init__(self):
        super(AgentNodeComponent, self).__init__()
        self.classes = {}
        for cls in get_agent_classes():
            self.classes[cls.agent_type] = cls

        self.agent_class = None
        self.tool_name = None

    def RunScript(self, depends_on: System.Collections.Generic.List[object]):
        ghc = GrasshopperNodeCreator() 
        return ghc.convert_node_to_task_definition(ghenv, self.agent_class, self.tool_name)

    def AppendAdditionalMenuItems(self, menu):
        for i, (agent_key, agent_class) in enumerate(self.classes.items()):
            if i > 0:
                menu.Items.Add(ToolStripSeparator())

            for tool in agent_class.tools:
                tool_item = menu.Items.Add(get_full_tool_name(agent_class, tool), None, self.on_tool_click)
                tool_item.Checked = self.tool_name == tool
 
        menu.Items.Add(ToolStripSeparator())

    def on_tool_click(self, sender, event_info):
        agent, tool = str(sender).split(".", 1)
        self.agent_class = self.classes.get(agent, "Failed to locate the agent class!")
        self.tool_name = tool
        
        # rename_cpython_gh_output(self.processing_type.__name__, 0, ghenv)
        # manage_cpython_dynamic_params(self.arg_names(), ghenv, rename_count=0, permanent_param_count=1)

        ghenv.Component.Message = str(sender)
        ghenv.Component.ExpireSolution(True)
# ---------- end B ----------
A = Script(depends_on=start)  # -> task, aaaa; inputs depends_on: list
# ---------- A: Python ----------
from compas_rhino.devtools import DevTools
DevTools.ensure_path()

from blueprint_composer import get_agent_classes
from blueprint_composer import get_full_tool_name
from blueprint_composer import GrasshopperNodeCreator

# from compas_ghpython import create_id

import Grasshopper
import System

from scriptcontext import sticky as st
from System.Windows.Forms import ToolStripMenuItem
from System.Windows.Forms import ToolStripSeparator


class AgentNodeComponent(Grasshopper.Kernel.GH_ScriptInstance):
    def __init__(self):
        super(AgentNodeComponent, self).__init__()
        self.classes = {}
        for cls in get_agent_classes():
            self.classes[cls.agent_type] = cls

        self.agent_class = None
        self.tool_name = None

    def RunScript(self, depends_on: System.Collections.Generic.List[object], x, y):
        ghc = GrasshopperNodeCreator()
        return ghc.convert_node_to_task_definition(ghenv, self.agent_class, self.tool_name)

    def AppendAdditionalMenuItems(self, menu):
        for i, (agent_key, agent_class) in enumerate(self.classes.items()):
            if i > 0:
                menu.Items.Add(ToolStripSeparator())

            for tool in agent_class.tools:
                tool_item = menu.Items.Add(get_full_tool_name(agent_class, tool), None, self.on_tool_click)
                tool_item.Checked = self.tool_name == tool
 
        menu.Items.Add(ToolStripSeparator())

    def on_tool_click(self, sender, event_info):
        agent, tool = str(sender).split(".", 1)
        self.agent_class = self.classes.get(agent, "Failed to locate the agent class!")
        self.tool_name = tool
        
        # rename_cpython_gh_output(self.processing_type.__name__, 0, ghenv)
        # manage_cpython_dynamic_params(self.arg_names(), ghenv, rename_count=0, permanent_param_count=1)

        ghenv.Component.Message = str(sender)
        ghenv.Component.ExpireSolution(True)
# ---------- end A ----------
end = Script(depends_on=[A.task, B.task])  # -> task, process_end_time; inputs depends_on: list
# ---------- end: Python ----------
from compas_rhino.devtools import DevTools
DevTools.ensure_path()

from blueprint_composer import get_agent_classes
from blueprint_composer import get_full_tool_name
from blueprint_composer import GrasshopperNodeCreator

# from compas_ghpython import create_id

import Grasshopper
import System

from scriptcontext import sticky as st
from System.Windows.Forms import ToolStripMenuItem
from System.Windows.Forms import ToolStripSeparator


class AgentNodeComponent(Grasshopper.Kernel.GH_ScriptInstance):
    def __init__(self):
        super(AgentNodeComponent, self).__init__()
        self.classes = {}
        for cls in get_agent_classes():
            self.classes[cls.agent_type] = cls

        self.agent_class = None
        self.tool_name = None

    def RunScript(self, depends_on: System.Collections.Generic.List[object]):
        ghc = GrasshopperNodeCreator()
        return ghc.convert_node_to_task_definition(ghenv, self.agent_class, self.tool_name)

    def AppendAdditionalMenuItems(self, menu):
        for i, (agent_key, agent_class) in enumerate(self.classes.items()):
            if i > 0:
                menu.Items.Add(ToolStripSeparator())

            for tool in agent_class.tools:
                tool_item = menu.Items.Add(get_full_tool_name(agent_class, tool), None, self.on_tool_click)
                tool_item.Checked = self.tool_name == tool
 
        menu.Items.Add(ToolStripSeparator())

    def on_tool_click(self, sender, event_info):
        agent, tool = str(sender).split(".", 1)
        self.agent_class = self.classes.get(agent, "Failed to locate the agent class!")
        self.tool_name = tool
        
        # rename_cpython_gh_output(self.processing_type.__name__, 0, ghenv)
        # manage_cpython_dynamic_params(self.arg_names(), ghenv, rename_count=0, permanent_param_count=1)

        ghenv.Component.Message = str(sender)
        ghenv.Component.ExpireSolution(True)
# ---------- end end ----------
blueprint = Script(tasks=end.task, blueprint_id="tp0", name="toy-problem-0", description="Test GH node to blueprint creator")  # -> out, blueprint; inputs tasks: list, blueprint_id: String, name: String, description: String
# ---------- blueprint: Python ----------
from compas_rhino.devtools import DevTools
DevTools.ensure_path()

"""Grasshopper Script Instance"""
import System
import Rhino
import Grasshopper

import rhinoscriptsyntax as rs

class MyComponent(Grasshopper.Kernel.GH_ScriptInstance):
    def RunScript(self,
            tasks: System.Collections.Generic.List[object],
            blueprint_id: str,
            name: str,
            description: str):

        if len(tasks) == 0:
            return

        composer = tasks[0].composer
        blueprint = composer.get_blueprint(blueprint_id, name, description)
        print(blueprint.__data__)
        return blueprint
# ---------- end blueprint ----------
panel = Panel(blueprint.out)
