# Grasshopper definition blueprint_start.ghx (Grasshopper 1.0.8)

panel = Panel("TP5_inner_pnp_only_ik")
start_blueprint = Python3Script(blueprint_id="toy-problem-1", start=Button())  # -> out, bsid; inputs blueprint_id: String, broker_host: String, broker_port: Int32, orchestrator_api: String
# ---------- start_blueprint: Python ----------
"""Grasshopper Script"""
import json
import urllib.request
import urllib.error

import Grasshopper
from compas_ghpython import create_id
from scriptcontext import sticky as st

class StartBlueprintComponent(Grasshopper.Kernel.GH_ScriptInstance):
    def RunScript(self,
            blueprint_id: str,
            broker_host: str,
            broker_port: int,
            orchestrator_api: str,
            start):

        broker_host = broker_host or "127.0.0.1"
        broker_port = broker_port or 1883
        orchestrator_api = orchestrator_api or "http://localhost:8000"

        key = create_id(ghenv.Component, "bsid_key")

        if start:
            st[key] = self.start_blueprint(orchestrator_api, blueprint_id, broker_host, broker_port)
        
        return st.get(key)

    def start_blueprint(self, orchestrator_api, blueprint_id, broker_host, broker_port):
        endpoint = f"{orchestrator_api}/blueprints/start"
        
        payload = {
            "blueprint_id": blueprint_id,
            "broker_host": broker_host,
            "broker_port": int(broker_port)
        }
        
        data = json.dumps(payload).encode("utf-8")
        req = urllib.request.Request(
            endpoint, 
            data=data, 
            headers={"Content-Type": "application/json"}, 
            method="POST"
        )
        
        try:
            with urllib.request.urlopen(req) as res:
                body = res.read().decode("utf-8")
                response = json.loads(body)
                return response["session_id"]
        except urllib.error.URLError as e:
            return {"error": str(e)}
        except Exception as e:
            return {"error": f"Unexpected error: {str(e)}"}
# ---------- end start_blueprint ----------
state = Python3Script(bsid=start_blueprint.bsid)  # -> diagram; inputs bsid: String, orchestrator_api: String
# ---------- state: Python ----------
"""Grasshopper Script"""
import json
import urllib.request
import urllib.error

import Grasshopper
from compas_ghpython import create_id
from compas_ghpython.timer import update_component
from scriptcontext import sticky as st

class GetSessionStateComponent(Grasshopper.Kernel.GH_ScriptInstance):
    def RunScript(self, bsid: str, orchestrator_api: str):
        orchestrator_api = orchestrator_api or "http://localhost:8000"

        key = create_id(ghenv.Component, "diagram")
        st[key] = self.get_diagram(orchestrator_api, bsid)

        data = st.get(key)
        if data:
            state, diagram = data
        else:
            state, diagram = "Undefined", None

        if state == "RUNNING":
            update_component(ghenv, 100)

        ghenv.Component.Message = state
        return diagram

    def get_diagram(self, orchestrator_api, bsid):
        endpoint = f"{orchestrator_api}/sessions/{bsid}/diagram"
        
        req = urllib.request.Request(
            endpoint, 
            headers={"Content-Type": "application/json"}, 
            method="GET"
        )
        
        try:
            with urllib.request.urlopen(req) as res:
                body = res.read().decode("utf-8")
                response = json.loads(body)
                return response["state"], response["diagram"]
        except urllib.error.URLError as e:
            return {"error": str(e)}
        except Exception as e:
            return {"error": f"Unexpected error: {str(e)}"}
# ---------- end state ----------
data = Python3Script(bsid=start_blueprint.bsid, update=Button())  # -> out, data; inputs bsid: String, orchestrator_api: String
# ---------- data: Python ----------
"""Grasshopper Script"""
import json
import urllib.request
import urllib.error

import Grasshopper
from compas.data import json_loads
from compas_ghpython import create_id
from scriptcontext import sticky as st

class GetSessionDataComponent(Grasshopper.Kernel.GH_ScriptInstance):
    def RunScript(self, bsid: str, orchestrator_api: str, update):
        orchestrator_api = orchestrator_api or "http://localhost:8000"

        key = create_id(ghenv.Component, "data")

        if update:
            st[key] = self.get_session_data(orchestrator_api, bsid)
        print(st[key])
        return st.get(key)

    def get_session_data(self, orchestrator_api, bsid):
        endpoint = f"{orchestrator_api}/sessions/{bsid}/data"
        
        req = urllib.request.Request(
            endpoint, 
            headers={"Content-Type": "application/json"}, 
            method="GET"
        )
        
        try:
            with urllib.request.urlopen(req) as res:
                body = res.read().decode("utf-8")
                response = json.loads(body)

                # COMPAS Deserialization of the payload
                return json_loads(response["data"])
        except urllib.error.URLError as e:
            return {"error": str(e)}
        except Exception as e:
            return {"error": f"Unexpected error: {str(e)}"}
# ---------- end data ----------
panel_2 = Panel(state)
panel_3 = Panel(data.out)
